# Grasshopper definition Baira_Stadium_Script.gh (Grasshopper 0.9.75)
# plug-ins: Python Interpreter

number_of_curve_divisions = Slider(20, range=0..200)
crv = Curve([<curve referenced from the Rhino model> x2])

# ---- group: input curve
crv_2 = Curve(reparameterize(<curve referenced from the Rhino model>))

# ----
divide = DivideCurve(Curve=crv, Count=2, Kinks=False)  # -> Points, Tangents, Parameters
pt = Point([<point referenced from the Rhino model> x3])
pt_2 = Point([<point referenced from the Rhino model> x3])
number_slider = Slider(7, range=0..20)
intcrv = Interpolate(Vertices=pt, Degree=3, Periodic=False, KnotStyle=1)  # -> reparameterize(Curve), Length, Domain
intcrv_2 = Interpolate(Vertices=pt_2, Degree=3, Periodic=False, KnotStyle=1)  # -> reparameterize(Curve), Length, Domain
python = PythonScript(curves=intcrv.Curve, samples=number_slider)  # -> out, arc; inputs curves: Curve, samples: Int32
# ---------- python: Python ----------
import rhinoscriptsyntax as rs
import ghpythonlib.components as gh

#===============================================
domrange=gh.Range(1, samples)
curvature=gh.Curvature(curves,domrange)
circleRad=gh.DeconstructArc(curvature[2])
circle=curvature[2]
logarithm=gh.Logarithm(circleRad[1])
adition=gh.MassAddition(logarithm)
division=gh.Division(logarithm,adition[0])
domains=gh.ConsecutiveDomains(division,True)
decompose=gh.DeconstructDomain(domains)
#==============================================
split=decompose[0]

shatter=gh.Shatter(curves,split)

ptA=[]
ptB=[]
ptC=[]
for i in range(0,len(shatter)):
    divCrv=gh.DivideCurve(shatter[i],2,False)
    pt1=gh.ListItem(divCrv[0],0,False)
    ptA.append(pt1)
    pt2=gh.ListItem(divCrv[0],1,False)
    ptB.append(pt2)
    pt3=gh.ListItem(divCrv[0],2,False)
    ptC.append(pt3)

arcs=gh.Arc3Pt(ptA,ptB,ptC)
arc=arcs[0]
# ---------- end python ----------
python_2 = PythonScript(curves=intcrv_2.Curve, samples=number_slider)  # -> out, arc; inputs curves: Curve, samples: Int32; same code as python
crv_3 = Curve(python.arc)
crv_4 = Curve(python_2.arc)
panel = Panel(python.arc)
panel_2 = Panel(python_2.arc)
join = JoinCurves(Curves=crv_3, Preserve=False)
join_2 = JoinCurves(Curves=crv_4, Preserve=False)
number_slider_2 = Slider(34, range=0..120)
end = EndPoints(Curve=join)  # -> Start, End
ln = Line(StartPoint=end.Start, EndPoint=end.End)
rotax = RotateAxis(Geometry=join, Angle=Slider(6.04, range=0..10), Axis=ln)  # -> Geometry, Transform
rotax_2 = RotateAxis(Geometry=join, Angle=Slider(6.52, range=0..10), Axis=ln)  # -> Geometry, Transform
divide_2 = DivideCurve(Curve=rotax.Geometry, Count=number_slider_2, Kinks=False)  # -> Points, Tangents, Parameters
divide_3 = DivideCurve(Curve=join_2, Count=number_slider_2, Kinks=False)  # -> Points, Tangents, Parameters
divide_4 = DivideCurve(Curve=rotax_2.Geometry, Count=number_slider_2, Kinks=False)  # -> Points, Tangents, Parameters
cull = CullPattern(List=divide_2.Points, CullPattern=[False, True])
cull_2 = CullPattern(List=divide_3.Points, CullPattern=[True, False])
cull_3 = CullPattern(List=divide_4.Points, CullPattern=[False, True])

# ---- group: curve start
end_2 = EndPoints(Curve=crv_2)  # -> Start, End
pcomp = Decompose(Point=end_2.Start, System=PlaneXY(0, 0, 0))  # -> XComponent, YComponent, ZComponent

# ----
weave = Weave(Pattern=[0, 1], Stream0=cull_2, Stream1=cull_3, NullGaps=False)
weave_2 = Weave(Pattern=[0, 1], Stream0=cull, Stream1=cull_2, NullGaps=False)
pline = PolyLine(Vertices=weave_2, Closed=False)
pline_2 = PolyLine(Vertices=weave, Closed=False)
explode = Explode(Curve=pline_2, Recursive=True)  # -> Segments, Vertices
explode_2 = Explode(Curve=pline, Recursive=True)  # -> Segments, Vertices
format = Format(Format="G01X{0:0.00}Y{1:1.00}", Data0=pcomp.XComponent, Data1=pcomp.YComponent)
clockwise = Panel("G02")
anti_clockwise = Panel("G03")
panel_3 = Panel("""%
G90
G21
G53X0Y0Z0
G54
G01Z0""")
panel_4 = Panel(format)

# ---- group: curvature analysis - greater curvature = closer point spacing
range = Range(Domain=Domain(0, 1), Steps=number_of_curve_divisions)
curvature = Curvature(Curve=crv_2, Parameter=range)  # -> P, K, C
cen = Center(Arc=curvature.C)  # -> Center, Radius

# ----
log = Logarithm(Value=cen.Radius)

# ---- group: curvature analysis - greater curvature = closer point spacing (continued)
ma = MassAddition(Input=log)  # -> Result, PartialResults
division = Division(A=log, B=ma.Result)
consec = ConsecutiveDomains(Numbers=division, Additive=True)
domcomp = DomainComponents(Domain=consec)  # -> Start, End

# ---- group: make arcs
shatter = Shatter(Curve=crv_2, Parameters=domcomp.Start)
curvepoint = PointOnCurve(shatter, parameter=0.502)
end_3 = EndPoints(Curve=shatter)  # -> Start, End
arc = Arc3Pt(PointA=end_3.Start, PointB=curvepoint, PointC=end_3.End)  # -> Arc, Plane, Radius

# ----
panel_5 = Panel(domcomp.Start)
crv_5 = Curve(reparameterize(arc.Arc))

# ---- group: rotation direction
crv_6 = Curve(crv_2)
eval = EvaluateCurve(Curve=crv_5, Parameter=Slider(0.001, range=0..1))  # -> Point, Tangent, Angle
curvature_2 = Curvature(Curve=arc.Arc, Parameter=domcomp.Start)  # -> P, K, C
xprod = CrossProduct(VectorA=eval.Tangent, VectorB=Vector(0, 0, 1), Unitize=True)  # -> Vector, Length
move = Move(Geometry=end_3.End, Motion=xprod.Vector)  # -> Geometry, Transform
vec2pt = Vector2Pt(PointA=move.Geometry, PointB=end_3.End, Unitize=False)  # -> Vector, Length
angle = Angle(VectorA=vec2pt.Vector, VectorB=curvature_2.K)  # -> Angle, Reflex
larger = LargerThan(FirstNumber=angle.Angle, SecondNumber="0.5 * Pi")  # -> LargerThan, OrEqualTo

# ---- group: arc analysis
cen_2 = Center(Arc=arc.Arc)  # -> Center, Radius
pcomp_2 = Decompose(Point=end_3.End, System=PlaneXY(0, 0, 0))  # -> XComponent, YComponent, ZComponent

# ---- group: sig fig
eval_2 = Evaluate(F="Round (x,1)", x=pcomp_2.XComponent)
eval_3 = Evaluate(F="Round (x,1)", x=pcomp_2.YComponent)
eval_4 = Evaluate(F="Round (x,1)", x=cen_2.Radius)

# ----
format_2 = Format(Format="X{0:0.00}Y{1:1.00}R{2:2.00}", Data0=eval_2, Data1=eval_3, Data2=eval_4)
long = LongList(ListA=anti_clockwise, ListB=larger.LargerThan, PaddingMode=2)  # -> ListA, ListB
long_2 = LongList(ListA=clockwise, ListB=larger.LargerThan, PaddingMode=2)  # -> ListA, ListB
p_n_c = PickNChoose(Pattern=long_2.ListB, Stream0=long.ListA, Stream1=long_2.ListA)
concat = Concatenate(A=p_n_c, B=format_2)
concat_2 = Concatenate(A=concat, B="F500000")
g_code = Panel([panel_3, panel_4, concat_2])
